# Grasshopper definition read-epd.gh (Grasshopper 1.0.7)
# plug-ins: PluginTemplate

getepds = GetEPDsFromÖkobau(Run=Toggle(True), Limit=10)
listepds = ListEPDs(JSONData=getepds)  # -> Names, UUIDs
panel = Panel(getepds)
panel_2 = Panel(listepds.UUIDs)
item = ListItem(List=listepds.UUIDs, Index=Slider(4, range=0..10), Wrap=True)
getepdbyuuid = GetEPDByUUID(Run=Toggle(True), UUID=item)
panel_3 = Panel(getepdbyuuid)
parseepd = ParseEPD(EPDResult=getepdbyuuid)  # -> Name, Unit, Amount, GWPData
panel_4 = Panel(parseepd.GWPData)
panel_5 = Panel(parseepd.Name)
panel_6 = Panel(parseepd.Unit)
panel_7 = Panel(parseepd.Amount)
parsegwp = ParseGWPData(EPDResult=parseepd.GWPData)  # -> A1A3, A4, A5, B1, C1, C2, C3, C4, D
panel_8 = Panel(parsegwp.C3)
